# Grasshopper definition planeInvert.gh (Grasshopper 1.0.8)

panel = Panel("0.95,0.433,0.0,0.05,0.567,0.475,0.0,0.0,0.525")
panel_2 = Panel("0.625,0.7,0.0,0.375,0.3,0.3,0.0,0.0,0.7")
panel_3 = Panel("0.299,0.299,0.299,0.587,0.587,0.587,0.114,0.114,0.114")
text_split = TextSplit(Text="0.2833108,0.9542531,0.0955819", Separators=",")
text_split_2 = TextSplit(Text="0.4556161,0.8910283,0.5665111", Separators=",")
text_split_3 = TextSplit(Text="0.5433477,0.1086155,0.4332448", Separators=",")
text_split_4 = TextSplit(Text="0.5,0.5,0.5", Separators=",")
text_split_5 = TextSplit(Text="1,0,0,0,0,0,1,0,0,1,0,0,0,0,0,1", Separators=",")
number = Number(text_split)
number_2 = Number(text_split_2)
number_3 = Number(text_split_3)
number_4 = Number(text_split_4)
number_5 = Number(text_split_5)
list_item = ListItem(List=number_2, Index=0, Wrap=True)  # -> Item, Item1, Item2
list_item_2 = ListItem(List=number, Index=0, Wrap=True)  # -> Item, Item1, Item2
list_item_3 = ListItem(List=number_4, Index=0, Wrap=True)  # -> Item, Item1, Item2
list_item_4 = ListItem(List=number_3, Index=0, Wrap=True)  # -> Item, Item1, Item2
number_slider = Slider(1, range=0..1)
point = Point(Point(1, 1, 1))
text_split_6 = TextSplit(Text="0.567,0.558,0.0,0.433,0.442,0.242,0.0,0.0,0.758", Separators=",")
construct_point = ConstructPoint(XCoordinate=list_item.Item, YCoordinate=list_item.Item1, ZCoordinate=list_item.Item2)
construct_point_2 = ConstructPoint(XCoordinate=list_item_2.Item, YCoordinate=list_item_2.Item1, ZCoordinate=list_item_2.Item2)
point_2 = Point(Point(0, 0, 0))
construct_point_3 = ConstructPoint(XCoordinate=list_item_3.Item, YCoordinate=list_item_3.Item1, ZCoordinate=list_item_3.Item2)
construct_point_4 = ConstructPoint(XCoordinate=list_item_4.Item, YCoordinate=list_item_4.Item1, ZCoordinate=list_item_4.Item2)
box_2pt = Box2Pt(PointA=point_2, PointB=point, Plane=PlaneXY(0, 0, 0))
negative = Negative(Value=number_slider)

# ----
# Rhino 2 Three
r_to_t = RToT()

# ----
# Three 2 Rhino
cluster = Cluster()

number_slider_2 = Slider(0, range=0..100)
number_6 = Number(text_split_6)
repeat_data = RepeatData(Data=construct_point_2, Length=Slider(3, range=0..10))
deconstruct_brep = DeconstructBrep(Brep=box_2pt)  # -> Faces, Edges, Vertices
construct_matrix = ConstructMatrix(Rows=3, Columns=3, Values=number_6)

number_slider_3 = Slider(4, range=0..10)
data = Data([0, 1, 0, 0, 0, 0, 1, 0, 1, 0, 0, 0, 0, 0, 0, 1])
construct_matrix_2 = ConstructMatrix(Rows=number_slider_3, Columns=number_slider_3, Values=number_5)
display_matrix = DisplayMatrix(construct_matrix_2)

data_2 = Data([construct_point_4, construct_point, construct_point_3])
data_3 = Data(deconstruct_brep.Edges)
construct_point_5 = ConstructPoint(XCoordinate=0, YCoordinate=0, ZCoordinate=number_slider)
construct_point_6 = ConstructPoint(XCoordinate=number_slider, YCoordinate=0, ZCoordinate=0)
construct_point_7 = ConstructPoint(XCoordinate=0, YCoordinate=number_slider, ZCoordinate=0)
construct_point_8 = ConstructPoint(XCoordinate=number_slider_2, YCoordinate=number_slider_2, ZCoordinate=number_slider_2)
transpose_matrix = TransposeMatrix(Matrix=construct_matrix)
point_3 = Point(Point(0.5, 0.5, 0))
plane_normal = PlaneNormal(Origin=data_2, ZAxis=repeat_data)
point_4 = Point(Point(0, 1, 0))
transform = Transform(Geometry=box_2pt, Transform=transpose_matrix)
deconstruct = Deconstruct(Point=construct_point_5)  # -> XComponent, YComponent, ZComponent
deconstruct_2 = Deconstruct(Point=construct_point_6)  # -> XComponent, YComponent, ZComponent
deconstruct_3 = Deconstruct(Point=construct_point_7)  # -> XComponent, YComponent, ZComponent
deconstruct_4 = Deconstruct(Point=construct_point_8)  # -> XComponent, YComponent, ZComponent
plane_normal_2 = PlaneNormal(Origin=point_3, ZAxis=point_4)
display_matrix_2 = DisplayMatrix(transpose_matrix)
mirror = Mirror(Plane=plane_normal_2)  # -> Geometry, Transform
inverse_transform = InverseTransform(Transform=construct_matrix_2)
data_4 = Data([deconstruct_3.XComponent, deconstruct_3.YComponent, deconstruct_3.ZComponent, Slider(0, range=0..100), deconstruct.XComponent, deconstruct.YComponent, deconstruct.ZComponent, Slider(0, range=0..100), deconstruct_2.XComponent, deconstruct_2.YComponent, deconstruct_2.ZComponent, Slider(0, range=0..100), deconstruct_4.XComponent, deconstruct_4.YComponent, deconstruct_4.ZComponent, Slider(1, range=0..100)])
compound = Compound(Transforms=flatten([mirror.Transform, inverse_transform]))
data_5 = Data(inverse_transform)
inverse_transform_2 = InverseTransform(Transform=transpose_matrix)
transform_2 = Transform(Geometry=plane_normal, Transform=data_5)
transform_3 = Transform(Geometry=transform, Transform=data_5)
number_slider_4 = Slider(100000, range=0..100000)
transform_4 = Transform(Geometry=plane_normal, Transform=inverse_transform_2)
negative_2 = Negative(Value=number_slider_4)
rectangle = Rectangle(Plane=transform_2, XSize=Domain(-1, 1), YSize=Domain(-2, 2), Radius=0)  # -> graft(Rectangle), Length
rectangle_2 = Rectangle(Plane=transform_2, XSize=Domain(-1, 1), YSize=Domain(-2, 2), Radius=0)  # -> graft(Rectangle), Length
bounds = Bounds(Numbers=[negative_2, number_slider_4])
rectangle_3 = Rectangle(Plane=transform_4, XSize=bounds, YSize=bounds, Radius=0)  # -> graft(Rectangle), Length
brep_brep = BrepBrep(BrepA=rectangle.Rectangle, BrepB=box_2pt)  # -> Curves, Points
brep_brep_2 = BrepBrep(BrepA=rectangle_2.Rectangle, BrepB=transform_3)  # -> Curves, Points
brep_brep_3 = BrepBrep(BrepA=rectangle_3.Rectangle, BrepB=box_2pt)  # -> Curves, Points

# ==== cluster RToT
vector = ClusterInput()
deconstruct_vector = DeconstructVector(Vector=vector)  # -> XComponent, YComponent, ZComponent
construct_point = ConstructPoint(
    XCoordinate=deconstruct_vector.ZComponent,
    YCoordinate=deconstruct_vector.XComponent,
    ZCoordinate=deconstruct_vector.YComponent)
point = ClusterOutput(construct_point)

# ==== cluster Cluster
vector = ClusterInput()
deconstruct_vector = DeconstructVector(Vector=vector)  # -> XComponent, YComponent, ZComponent
construct_point = ConstructPoint(
    XCoordinate=deconstruct_vector.YComponent,
    YCoordinate=deconstruct_vector.ZComponent,
    ZCoordinate=deconstruct_vector.XComponent)
point = ClusterOutput(construct_point)
