# Grasshopper definition sdf color planes .gh (Grasshopper 1.0.8)

point = Point(Point(1, 1, 1))
point_2 = Point(Point(0, 0, 0))
box_2pt = Box2Pt(PointA=point_2, PointB=point, Plane=PlaneXY(0, 0, 0))

# ----
# Rhino 2 Three
r_to_t = RToT()

# ----
# Three 2 Rhino
cluster = Cluster()

deconstruct_brep = DeconstructBrep(Brep=box_2pt)  # -> Faces, Edges, Vertices
data = Data(deconstruct_brep.Edges)
relay = Relay()
text_distance = TextDistance(TextA=relay, TextB=ColourSwatch(SwatchColor=RGB(255, 255, 255)), Case=True)  # disabled
panel = Panel(text_distance)  # disabled
number_slider = Slider(0, range=0..100)  # disabled

# ----
# Contrast Ratio of 4.5
colour_swatch = ColourSwatch(SwatchColor=RGB(14, 48, 18))  # disabled
colour_swatch_2 = ColourSwatch(SwatchColor=RGB(158, 5, 15))  # disabled
colour_swatch_3 = ColourSwatch(SwatchColor=RGB(26, 23, 230))  # disabled
colour_swatch_4 = ColourSwatch(SwatchColor=RGB(49, 30, 87))  # disabled
colour_swatch_5 = ColourSwatch(SwatchColor=RGB(94, 15, 106))  # disabled
colour_swatch_6 = ColourSwatch(SwatchColor=RGB(127, 2, 141))  # disabled
colour_swatch_7 = ColourSwatch(SwatchColor=RGB(8, 36, 150))  # disabled
colour_swatch_8 = ColourSwatch(SwatchColor=RGB(34, 20, 234))  # disabled
colour_swatch_9 = ColourSwatch(SwatchColor=RGB(128, 12, 33))  # disabled
colour_swatch_10 = ColourSwatch(SwatchColor=RGB(138, 3, 87))  # disabled
colour_swatch_11 = ColourSwatch(SwatchColor=RGB(75, 30, 16))  # disabled
colour_swatch_12 = ColourSwatch(SwatchColor=RGB(112, 4, 155))  # disabled
colour_swatch_13 = ColourSwatch(SwatchColor=RGB(17, 46, 27))  # disabled
colour_swatch_14 = ColourSwatch(SwatchColor=RGB(34, 21, 217))  # disabled
colour_swatch_15 = ColourSwatch(SwatchColor=RGB(20, 32, 151))  # disabled
colour_swatch_16 = ColourSwatch(SwatchColor=RGB(110, 2, 181))  # disabled
colour_swatch_17 = ColourSwatch(SwatchColor=RGB(90, 2, 247))  # disabled
colour_swatch_18 = ColourSwatch(SwatchColor=RGB(48, 15, 243))  # disabled
colour_swatch_19 = ColourSwatch(SwatchColor=RGB(59, 23, 132))  # disabled
colour_swatch_20 = ColourSwatch(SwatchColor=RGB(112, 4, 155))  # disabled
colour_swatch_21 = ColourSwatch(SwatchColor=RGB(17, 46, 27))  # disabled
colour_swatch_22 = ColourSwatch(SwatchColor=RGB(90, 16, 106))  # disabled
colour_swatch_23 = ColourSwatch(SwatchColor=RGB(25, 35, 103))  # disabled
colour_swatch_24 = ColourSwatch(SwatchColor=RGB(24, 27, 187))  # disabled
colour_swatch_25 = ColourSwatch(SwatchColor=RGB(250, 228, 6))  # disabled
colour_swatch_26 = ColourSwatch(SwatchColor=RGB(173, 250, 14))  # disabled
colour_swatch_27 = ColourSwatch(SwatchColor=RGB(93, 253, 224))  # disabled
colour_swatch_28 = ColourSwatch(SwatchColor=RGB(248, 205, 247))  # disabled
colour_swatch_29 = ColourSwatch(SwatchColor=RGB(174, 242, 90))  # disabled
colour_swatch_30 = ColourSwatch(SwatchColor=RGB(210, 225, 155))  # disabled
colour_swatch_31 = ColourSwatch(SwatchColor=RGB(133, 243, 199))  # disabled
colour_swatch_32 = ColourSwatch(SwatchColor=RGB(216, 217, 218))  # disabled
colour_swatch_33 = ColourSwatch(SwatchColor=RGB(84, 253, 249))  # disabled
colour_swatch_34 = ColourSwatch(SwatchColor=RGB(191, 242, 37))  # disabled
colour_swatch_35 = ColourSwatch(SwatchColor=RGB(228, 212, 229))  # disabled
colour_swatch_36 = ColourSwatch(SwatchColor=RGB(140, 250, 113))  # disabled
colour_swatch_37 = ColourSwatch(SwatchColor=RGB(143, 242, 187))  # disabled
colour_swatch_38 = ColourSwatch(SwatchColor=RGB(190, 242, 45))  # disabled
colour_swatch_39 = ColourSwatch(SwatchColor=RGB(125, 243, 224))  # disabled
colour_swatch_40 = ColourSwatch(SwatchColor=RGB(185, 235, 129))  # disabled
colour_swatch_41 = ColourSwatch(SwatchColor=RGB(247, 204, 247))  # disabled
colour_swatch_42 = ColourSwatch(SwatchColor=RGB(164, 253, 6))  # disabled
colour_swatch_43 = ColourSwatch(SwatchColor=RGB(164, 240, 147))  # disabled
colour_swatch_44 = ColourSwatch(SwatchColor=RGB(244, 229, 16))  # disabled
colour_swatch_45 = ColourSwatch(SwatchColor=RGB(234, 226, 70))  # disabled
colour_swatch_46 = ColourSwatch(SwatchColor=RGB(186, 230, 171))  # disabled
colour_swatch_47 = ColourSwatch(SwatchColor=RGB(225, 223, 130))  # disabled
colour_swatch_48 = ColourSwatch(SwatchColor=RGB(168, 232, 209))  # disabled
relay_2 = Relay([colour_swatch, colour_swatch_2, colour_swatch_3, colour_swatch_4, colour_swatch_5, colour_swatch_6, colour_swatch_7, colour_swatch_8, colour_swatch_9, colour_swatch_10, colour_swatch_11, colour_swatch_12, colour_swatch_13, colour_swatch_14, colour_swatch_15, colour_swatch_16, colour_swatch_17, colour_swatch_19, colour_swatch_20, colour_swatch_21, colour_swatch_22, colour_swatch_23, colour_swatch_24])  # disabled
panel_2 = Panel(",")  # disabled
relay_3 = Relay([colour_swatch_25, colour_swatch_26, colour_swatch_27, colour_swatch_28, colour_swatch_29, colour_swatch_30, colour_swatch_31, colour_swatch_32, colour_swatch_33, colour_swatch_34, colour_swatch_35, colour_swatch_37, colour_swatch_38, colour_swatch_39, colour_swatch_40, colour_swatch_41, colour_swatch_42, colour_swatch_43, colour_swatch_44, colour_swatch_45, colour_swatch_46, colour_swatch_47, colour_swatch_48])  # disabled
panel_3 = Panel(",")  # disabled
text_split = TextSplit(Text=relay_2, Separators=panel_2)  # disabled
text_split_2 = TextSplit(Text=relay_3, Separators=panel_3)  # disabled
list_item = ListItem(List=text_split, Index=0, Wrap=True)  # -> Item, Item1, Item2; disabled
list_item_2 = ListItem(List=text_split_2, Index=0, Wrap=True)  # -> Item, Item1, Item2; disabled
construct_point = ConstructPoint(XCoordinate=list_item.Item, YCoordinate=list_item.Item2, ZCoordinate=list_item.Item1)  # -> flatten(Point); disabled
construct_point_2 = ConstructPoint(XCoordinate=list_item_2.Item, YCoordinate=list_item_2.Item2, ZCoordinate=list_item_2.Item1)  # -> flatten(Point); disabled
division = Division(A=construct_point, B=255)  # disabled
division_2 = Division(A=construct_point_2, B=255)  # disabled
point_3 = Point(Point(0.5, 0.5, 0.5))  # disabled
plane_fit = PlaneFit(Points=division_2)  # -> Plane, Deviation; disabled
plane_fit_2 = PlaneFit(Points=division)  # -> Plane, Deviation; disabled
rectangle = Rectangle(Plane=plane_fit_2.Plane, XSize=Domain(-1, 1), YSize=Domain(-2, 2), Radius=0)  # -> Rectangle, Length; disabled
deconstruct_plane = DeconstructPlane(Plane=plane_fit_2.Plane)  # -> Origin, XAxis, YAxis, ZAxis; disabled
plane_closest_point = PlaneClosestPoint(Point=point_3, Plane=plane_fit_2.Plane)  # -> Point, UVPoint, Distance; disabled
rectangle_2 = Rectangle(Plane=plane_fit.Plane, XSize=Domain(-1, 1), YSize=Domain(-2, 2), Radius=0)  # -> Rectangle, Length; disabled
plane_closest_point_2 = PlaneClosestPoint(Point=point_3, Plane=plane_fit.Plane)  # -> Point, UVPoint, Distance; disabled
deconstruct_plane_2 = DeconstructPlane(Plane=plane_fit.Plane)  # -> Origin, XAxis, YAxis, ZAxis; disabled
number_slider_2 = Slider(0.2, range=0..1)  # disabled
brep_brep = BrepBrep(BrepA=rectangle_2.Rectangle, BrepB=box_2pt)  # -> Curves, Points; disabled
brep_brep_2 = BrepBrep(BrepA=rectangle.Rectangle, BrepB=box_2pt)  # -> Curves, Points; disabled
number_slider_3 = Slider(0.2, range=0..1)  # disabled
panel_4 = Panel(plane_closest_point.Distance)  # disabled
panel_5 = Panel(plane_closest_point_2.Distance)  # disabled
polygon_center = PolygonCenter(Polyline=brep_brep.Curves)  # -> CenterV, CenterE, CenterA; disabled
polygon_center_2 = PolygonCenter(Polyline=brep_brep_2.Curves)  # -> CenterV, CenterE, CenterA; disabled
line_sdl = LineSDL(Start=polygon_center_2.CenterV, Direction=deconstruct_plane.ZAxis, Length=number_slider_3)  # disabled
line_sdl_2 = LineSDL(Start=polygon_center.CenterV, Direction=deconstruct_plane_2.ZAxis, Length=number_slider_2)  # disabled
panel_6 = Panel(deconstruct_plane.ZAxis)  # disabled
panel_7 = Panel(deconstruct_plane_2.ZAxis)  # disabled

equality = Equality(FirstNumber=panel, SecondNumber=number_slider)  # -> Equality, Inequality; disabled

# ----
# Contrast Ratio of 7.5
panel_8 = Panel(",")  # disabled
relay_4 = Relay()  # disabled
relay_5 = Relay()  # disabled
panel_9 = Panel(",")  # disabled
text_split_3 = TextSplit(Text=relay_4, Separators=panel_8)  # disabled
text_split_4 = TextSplit(Text=relay_5, Separators=panel_9)  # disabled
list_item_3 = ListItem(List=text_split_3, Index=0, Wrap=True)  # -> Item, Item1, Item2; disabled
list_item_4 = ListItem(List=text_split_4, Index=0, Wrap=True)  # -> Item, Item1, Item2; disabled
construct_point_3 = ConstructPoint(XCoordinate=list_item_3.Item, YCoordinate=list_item_3.Item2, ZCoordinate=list_item_3.Item1)  # -> flatten(Point); disabled
construct_point_4 = ConstructPoint(XCoordinate=list_item_4.Item, YCoordinate=list_item_4.Item2, ZCoordinate=list_item_4.Item1)  # -> flatten(Point); disabled
division_3 = Division(A=construct_point_3, B=255)  # disabled
division_4 = Division(A=construct_point_4, B=255)  # disabled
point_4 = Point(Point(0.5, 0.5, 0.5))  # disabled
plane_fit_3 = PlaneFit(Points=division_4)  # -> Plane, Deviation; disabled
plane_fit_4 = PlaneFit(Points=division_3)  # -> Plane, Deviation; disabled
rectangle_3 = Rectangle(Plane=plane_fit_4.Plane, XSize=Domain(-1, 1), YSize=Domain(-2, 2), Radius=0)  # -> Rectangle, Length; disabled
deconstruct_plane_3 = DeconstructPlane(Plane=plane_fit_4.Plane)  # -> Origin, XAxis, YAxis, ZAxis; disabled
plane_closest_point_3 = PlaneClosestPoint(Point=point_4, Plane=plane_fit_4.Plane)  # -> Point, UVPoint, Distance; disabled
rectangle_4 = Rectangle(Plane=plane_fit_3.Plane, XSize=Domain(-1, 1), YSize=Domain(-2, 2), Radius=0)  # -> Rectangle, Length; disabled
plane_closest_point_4 = PlaneClosestPoint(Point=point_4, Plane=plane_fit_3.Plane)  # -> Point, UVPoint, Distance; disabled
deconstruct_plane_4 = DeconstructPlane(Plane=plane_fit_3.Plane)  # -> Origin, XAxis, YAxis, ZAxis; disabled
number_slider_4 = Slider(0.2, range=0..1)  # disabled
brep_brep_3 = BrepBrep(BrepA=rectangle_4.Rectangle, BrepB=box_2pt)  # -> Curves, Points; disabled
brep_brep_4 = BrepBrep(BrepA=rectangle_3.Rectangle, BrepB=box_2pt)  # -> Curves, Points; disabled
number_slider_5 = Slider(0.2, range=0..1)  # disabled
panel_10 = Panel(plane_closest_point_3.Distance)  # disabled
panel_11 = Panel(plane_closest_point_4.Distance)  # disabled
polygon_center_3 = PolygonCenter(Polyline=brep_brep_3.Curves)  # -> CenterV, CenterE, CenterA; disabled
polygon_center_4 = PolygonCenter(Polyline=brep_brep_4.Curves)  # -> CenterV, CenterE, CenterA; disabled
line_sdl_3 = LineSDL(Start=polygon_center_4.CenterV, Direction=deconstruct_plane_3.ZAxis, Length=number_slider_5)  # disabled
line_sdl_4 = LineSDL(Start=polygon_center_3.CenterV, Direction=deconstruct_plane_4.ZAxis, Length=number_slider_4)  # disabled
panel_12 = Panel(deconstruct_plane_3.ZAxis)  # disabled
panel_13 = Panel(deconstruct_plane_4.ZAxis)  # disabled

gate_not = GateNot(A=equality.Equality)  # disabled
cull_pattern = CullPattern(List=relay, CullPattern=gate_not)  # disabled

custom_preview = CustomPreview(Geometry=division, Material=relay_2)  # disabled
vector_display = VectorDisplay(Anchor=polygon_center_2.CenterV, Vector=line_sdl)  # disabled
data_2 = Data(brep_brep_2.Curves)  # disabled

custom_preview_2 = CustomPreview(
    Geometry=division_3,
    Material={diffuse=RGB(221, 160, 221), emission=RGB(66, 48, 66), shine=0.5, specular=RGB(255, 255, 255), transparency=0})  # disabled
vector_display_2 = VectorDisplay(Anchor=polygon_center_4.CenterV, Vector=line_sdl_3)  # disabled
data_3 = Data(brep_brep_4.Curves)  # disabled

vector_display_3 = VectorDisplay(Anchor=polygon_center.CenterV, Vector=line_sdl_2)  # disabled
custom_preview_3 = CustomPreview(Geometry=division_2, Material=relay_3)  # disabled
data_4 = Data(brep_brep.Curves)  # disabled

vector_display_4 = VectorDisplay(Anchor=polygon_center_3.CenterV, Vector=line_sdl_4)  # disabled
custom_preview_4 = CustomPreview(Geometry=division_4, Material=relay_5)  # disabled
data_5 = Data(brep_brep_3.Curves)  # disabled

point_5 = Point(Point(0.5, 0.5, 0.5))

# ----
# Contrast Ratio of 3
colour_swatch_49 = ColourSwatch(SwatchColor=RGB(250, 201, 4))
number_slider_6 = Slider(0.2, range=0..1)
point_6 = Point(Point(0.5, 0.5, 0.5))
relay_6 = Relay([ColourSwatch(SwatchColor=RGB(5, 53, 250)), ColourSwatch(SwatchColor=RGB(7, 77, 10)), ColourSwatch(SwatchColor=RGB(179, 2, 249)), ColourSwatch(SwatchColor=RGB(252, 1, 43)), ColourSwatch(SwatchColor=RGB(113, 31, 150)), ColourSwatch(SwatchColor=RGB(97, 31, 205)), ColourSwatch(SwatchColor=RGB(121, 39, 51)), ColourSwatch(SwatchColor=RGB(159, 17, 157)), ColourSwatch(SwatchColor=RGB(248, 5, 10)), ColourSwatch(SwatchColor=RGB(6, 58, 206)), ColourSwatch(SwatchColor=RGB(206, 1, 175)), ColourSwatch(SwatchColor=RGB(208, 10, 78)), ColourSwatch(SwatchColor=RGB(179, 15, 116)), ColourSwatch(SwatchColor=RGB(70, 55, 37)), ColourSwatch(SwatchColor=RGB(36, 61, 78)), ColourSwatch(SwatchColor=RGB(70, 59, 7)), ColourSwatch(SwatchColor=RGB(129, 41, 6)), ColourSwatch(SwatchColor=RGB(208, 18, 4)), ColourSwatch(SwatchColor=RGB(235, 9, 16)), ColourSwatch(SwatchColor=RGB(250, 1, 46)), ColourSwatch(SwatchColor=RGB(218, 10, 51)), ColourSwatch(SwatchColor=RGB(225, 1, 122)), ColourSwatch(SwatchColor=RGB(200, 1, 199)), ColourSwatch(SwatchColor=RGB(190, 1, 227)), ColourSwatch(SwatchColor=RGB(4, 72, 68)), ColourSwatch(SwatchColor=RGB(4, 64, 145)), ColourSwatch(SwatchColor=RGB(4, 60, 192)), ColourSwatch(SwatchColor=RGB(4, 56, 228)), ColourSwatch(SwatchColor=RGB(25, 47, 250)), ColourSwatch(SwatchColor=RGB(75, 32, 251)), ColourSwatch(SwatchColor=RGB(118, 19, 252)), ColourSwatch(SwatchColor=RGB(157, 8, 250)), ColourSwatch(SwatchColor=RGB(82, 44, 112)), ColourSwatch(SwatchColor=RGB(53, 48, 160))])
relay_7 = Relay([colour_swatch_49, ColourSwatch(SwatchColor=RGB(74, 254, 3)), ColourSwatch(SwatchColor=RGB(3, 254, 211)), ColourSwatch(SwatchColor=RGB(3, 250, 254)), ColourSwatch(SwatchColor=RGB(250, 177, 251)), ColourSwatch(SwatchColor=RGB(121, 227, 136)), ColourSwatch(SwatchColor=RGB(117, 241, 7)), ColourSwatch(SwatchColor=RGB(201, 216, 4)), ColourSwatch(SwatchColor=RGB(248, 195, 78)), ColourSwatch(SwatchColor=RGB(248, 185, 177)), ColourSwatch(SwatchColor=RGB(198, 192, 253)), ColourSwatch(SwatchColor=RGB(115, 217, 251)), ColourSwatch(SwatchColor=RGB(44, 238, 253)), ColourSwatch(SwatchColor=RGB(61, 254, 43)), ColourSwatch(SwatchColor=RGB(29, 254, 135)), ColourSwatch(SwatchColor=RGB(39, 244, 207)), ColourSwatch(SwatchColor=RGB(82, 239, 125)), ColourSwatch(SwatchColor=RGB(91, 242, 68)), ColourSwatch(SwatchColor=RGB(142, 230, 36)), ColourSwatch(SwatchColor=RGB(187, 204, 165)), ColourSwatch(SwatchColor=RGB(194, 213, 52)), ColourSwatch(SwatchColor=RGB(113, 223, 195)), ColourSwatch(SwatchColor=RGB(193, 208, 107)), ColourSwatch(SwatchColor=RGB(195, 198, 204))])
text_split_5 = TextSplit(Text=relay_6, Separators=",")
text_split_6 = TextSplit(Text=relay_7, Separators=",")
list_item_5 = ListItem(List=text_split_6, Index=0, Wrap=True)  # -> Item, Item1, Item2
list_item_6 = ListItem(List=text_split_5, Index=0, Wrap=True)  # -> Item, Item1, Item2
construct_point_5 = ConstructPoint(XCoordinate=list_item_5.Item, YCoordinate=list_item_5.Item1, ZCoordinate=list_item_5.Item2)  # -> flatten(Point)
construct_point_6 = ConstructPoint(XCoordinate=list_item_6.Item, YCoordinate=list_item_6.Item1, ZCoordinate=list_item_6.Item2)  # -> flatten(Point)

# ----
# Rhino 2 Three
r_to_t_2 = RToT(vector=construct_point_5)

# ----
# Rhino 2 Three
r_to_t_3 = RToT(vector=construct_point_6)

division_5 = Division(A=r_to_t_2, B=255)
division_6 = Division(A=r_to_t_3, B=255)
plane_fit_5 = PlaneFit(Points=division_5)  # -> Plane, Deviation
plane_fit_6 = PlaneFit(Points=division_6)  # -> Plane, Deviation
rectangle_5 = Rectangle(Plane=plane_fit_6.Plane, XSize=Domain(-1, 1), YSize=Domain(-2, 2), Radius=0)  # -> Rectangle, Length
plane_closest_point_5 = PlaneClosestPoint(Point=point_6, Plane=plane_fit_6.Plane)  # -> Point, UVPoint, Distance
deconstruct_plane_5 = DeconstructPlane(Plane=plane_fit_6.Plane)  # -> Origin, XAxis, YAxis, ZAxis
plane_closest_point_6 = PlaneClosestPoint(Point=point_6, Plane=plane_fit_5.Plane)  # -> Point, UVPoint, Distance
rectangle_6 = Rectangle(Plane=plane_fit_5.Plane, XSize=Domain(-1, 1), YSize=Domain(-2, 2), Radius=0)  # -> Rectangle, Length
deconstruct_plane_6 = DeconstructPlane(Plane=plane_fit_5.Plane)  # -> Origin, XAxis, YAxis, ZAxis
brep_brep_5 = BrepBrep(BrepA=rectangle_5.Rectangle, BrepB=box_2pt)  # -> Curves, Points
brep_brep_6 = BrepBrep(BrepA=rectangle_6.Rectangle, BrepB=box_2pt)  # -> Curves, Points
polygon_center_5 = PolygonCenter(Polyline=brep_brep_5.Curves)  # -> CenterV, CenterE, CenterA
polygon_center_6 = PolygonCenter(Polyline=brep_brep_6.Curves)  # -> CenterV, CenterE, CenterA
line_sdl_5 = LineSDL(Start=polygon_center_5.CenterV, Direction=deconstruct_plane_5.ZAxis, Length=number_slider_6)
line_sdl_6 = LineSDL(Start=polygon_center_6.CenterV, Direction=deconstruct_plane_6.ZAxis, Length=number_slider_6)

panel_14 = Panel(plane_closest_point_5.Distance)
panel_15 = Panel(deconstruct_plane_5.ZAxis)
vector_display_5 = VectorDisplay(Anchor=polygon_center_5.CenterV, Vector=line_sdl_5)
data_6 = Data(brep_brep_5.Curves)
custom_preview_5 = CustomPreview(Geometry=division_6, Material=relay_6)

data_7 = Data(brep_brep_6.Curves)
panel_16 = Panel(plane_closest_point_6.Distance)
custom_preview_6 = CustomPreview(Geometry=division_5, Material=relay_7)
vector_display_6 = VectorDisplay(Anchor=polygon_center_6.CenterV, Vector=line_sdl_6)
panel_17 = Panel(deconstruct_plane_6.ZAxis)

number = Number([panel_14, panel_16])
vector = Vector(panel_17)
data_8 = Data(division_6)
data_9 = Data(division_5)
vector_2 = Vector(panel_15)
average = Average(Input=number)
panel_18 = Panel(average)
number_2 = Number(panel_18)
amplitude = Amplitude(Vector=vector, Amplitude=number_2)
amplitude_2 = Amplitude(Vector=vector_2, Amplitude=number_2)
move = Move(Geometry=data_9, Motion=amplitude)  # -> Geometry, Transform
move_2 = Move(Geometry=data_8, Motion=amplitude_2)  # -> Geometry, Transform
data_10 = Data([move_2.Geometry, move.Geometry])
plane_fit_7 = PlaneFit(Points=data_10)  # -> Plane, Deviation
plane_origin = PlaneOrigin(Base=plane_fit_7.Plane, Origin=point_5)

# ----
# Three 2 Rhino
cluster_2 = Cluster(vector=polygon_center_6.CenterV)

# ----
# Three 2 Rhino
cluster_3 = Cluster(vector=polygon_center_5.CenterV)

deconstruct_plane_7 = DeconstructPlane(Plane=plane_origin)  # -> Origin, XAxis, YAxis, ZAxis
panel_19 = Panel(cluster_2)
panel_20 = Panel(cluster_3)

# ----
# Three 2 Rhino
cluster_4 = Cluster(vector=deconstruct_plane_7.ZAxis)

line_sdl_7 = LineSDL(Start=deconstruct_plane_7.Origin, Direction=deconstruct_plane_7.ZAxis, Length=Slider(1, range=0..1))
panel_21 = Panel(cluster_4)

# ==== cluster RToT
vector = ClusterInput()
deconstruct_vector = DeconstructVector(Vector=vector)  # -> XComponent, YComponent, ZComponent
construct_point = ConstructPoint(
    XCoordinate=deconstruct_vector.ZComponent,
    YCoordinate=deconstruct_vector.XComponent,
    ZCoordinate=deconstruct_vector.YComponent)
point = ClusterOutput(construct_point)

# ==== cluster Cluster
vector = ClusterInput()
deconstruct_vector = DeconstructVector(Vector=vector)  # -> XComponent, YComponent, ZComponent
construct_point = ConstructPoint(
    XCoordinate=deconstruct_vector.YComponent,
    YCoordinate=deconstruct_vector.ZComponent,
    ZCoordinate=deconstruct_vector.XComponent)
point = ClusterOutput(construct_point)
